# Dynamo graph script.dyn (Dynamo 2.6.2.15705)
# packages: Data-Shapes 2022.2.103, Structural Design 2021.1.22, Orchid 206.3.0.8161, Clockwork for Dynamo 2.x 2.4.0, Genius Loci 2021.11.10, spring nodes 210.1.1

code_block = CodeBlock { 0.5; }
o_document_activeview = Orchid.RevitProject.Common.Document.ActiveView()
o_document_activeview_2 = Orchid.RevitProject.Common.Document.ActiveView()
firstItem = List.FirstItem()  # unwired: list
byBestFitThroughPoints = Line.ByBestFitThroughPoints()  # unwired: bestFitPoints
byUnion = Solid.ByUnion()  # unwired: solids
code_block_2 = CodeBlock { "Armadura Cabezal"; }
file_path = Filename("..\..\..\..\..\..\..\..\..\..\Arainco\Arainco.png")
code_block_3 = CodeBlock { "INICIAR"; "CANCELAR"; true; 430; 170; 650; }
categories_ᶜᵒⁿᵛᵉʳᵗᵉᵈ_ᵈʳᵒᵖᵈᵒʷⁿ = CodeBlock { "Seleccionar Muros a Armar"; "SELECCIONAR"; Revit.Category.ByName(["Walls","Structural Foundations"]); }
selectmodelelements_data = Custom[SelectModelElements Data](InputName=categories_ᶜᵒⁿᵛᵉʳᵗᵉᵈ_ᵈʳᵒᵖᵈᵒʷⁿ.out0, ButtonText=categories_ᶜᵒⁿᵛᵉʳᵗᵉᵈ_ᵈʳᵒᵖᵈᵒʷⁿ.out1, CategoryFilter=categories_ᶜᵒⁿᵛᵉʳᵗᵉᵈ_ᵈʳᵒᵖᵈᵒʷⁿ.out2)  # package Data-Shapes; Creates a Revit element selection input for UI.MultipleInputForm++ . Check out www.data-shapes.net for more infos!
code_block_4 = CodeBlock { "Seleccionar Cara de\nDistribucion"; "SELECCIONAR"; }
selectfaces_data = Custom[SelectFaces Data](InputName=code_block_4.out0, ButtonText=code_block_4.out1)  # package Data-Shapes; Creates a Revit face selection input for UI.MultipleInputForm++. Check out www.data-shapes.net for more infos!
code_block_5 = CodeBlock { "Puntos de Empalme"; "SELECCIONAR"; }
selectfaces_data_2 = Custom[SelectFaces Data](InputName=code_block_5.out0, ButtonText=code_block_5.out1)
code_block_6 = CodeBlock { "Datos de Armadura"; }
code_block_7 = CodeBlock { "Diametro"; }
element_types_ᶜᵒⁿᵛᵉʳᵗᵉᵈ_ᵈʳᵒᵖᵈᵒʷⁿ = CodeBlock { DSCore.Types.FindTypeByNameInAssembly("RebarBarType", "RevitAPI"); }
all_elements_of_type = ElementsOfType(element_type=element_types_ᶜᵒⁿᵛᵉʳᵗᵉᵈ_ᵈʳᵒᵖᵈᵒʷⁿ)
code_block_8 = CodeBlock(t5=all_elements_of_type)
# ---------- code_block_8.designscript (8 lines) ----------
t4 = t5;
t1 = t4;
num1 = Properties.RebarDiameter(t1);
t2 = DSCore.List.SortByKey(t1, num1);
t3 = Dictionary.ValueAtKey(t2, "sorted list");
str1 = Revit.Elements.Element.Name(t3);
0;
false;
# ----------------------------------------
dropdown_data = Custom[DropDown Data](InputName=code_block_7, Keys=code_block_8.str1, Values=code_block_8.t3, DefaultValueIndex=code_block_8.out6, Sorted_optional=code_block_8.out7)  # package Data-Shapes; Create data for DropDown input in UI.MultiInputForm ++ . Check out www.data-shapes.net for more infos.
code_block_9 = CodeBlock { "Cantidad de Barras"; "2"; true; }
textbox_data = Custom[TextBox Data](InputName=code_block_9.out0, DefaultText=code_block_9.out1, IsNumberEntry=code_block_9.out2)  # package Data-Shapes; Create Data for TextBox input in UI.MultipleInputForm ++ . Check out www.data-shapes.net for more informations
code_block_10 = CodeBlock { "Capa"; ["1ª Capa", "2ª Capa", "3ª Capa", "4ª Capa", "5ª Capa"]; [40, 90, 140, 190, 240]; 0; }
dropdown_data_2 = Custom[DropDown Data](InputName=code_block_10.out0, Keys=code_block_10.out1, Values=code_block_10.out2, DefaultValueIndex=code_block_10.out3)
list_create = List.Create(item0=dropdown_data, item1=textbox_data, item2=dropdown_data_2)
inputgroup_data = Custom[InputGroup Data](GroupTitle=code_block_6, Inputs=list_create)  # package Data-Shapes; Creates a group of inputs for UI.MultipleInputForm ++ . Check out www.data-shapes.net for more infos !
list_create_2 = List.Create(item0=selectmodelelements_data, item1=selectfaces_data, item2=selectfaces_data_2, item3=inputgroup_data)
multipleinputform = Custom[MultipleInputForm ++](Description_optional=code_block_2, Logo_optional=file_path, ButtonText_optional=code_block_3.out0, Inputs=list_create_2, Toggle=code_block_3.out2, CancelButtonText_optional=code_block_3.out1, MaxHeight_optional=code_block_3.out5, Width_optional=code_block_3.out3, LabelWidth_optional=code_block_3.out4)  # package Data-Shapes; Create a form with multiple inputs. see www.data-shapes.net for tutorials and infos!
code_block_11 = CodeBlock(l=multipleinputform.User_Inputs)
# ---------- code_block_11.designscript (12 lines) ----------
l;
[Imperative]
{
	if (l == null)
	{
		return = [[],[],[],[],[],[]];
	}
	else
	{
		return = l;
	}
};
# ----------------------------------------
code_block_12 = CodeBlock(x=code_block_11.out1) { x; }
code_block_13 = CodeBlock(x=code_block_12) { x[0]; }
geometry = Element.Geometry(element=code_block_13)
flatten = List.Flatten(list=geometry)
function_apply = ApplyFunction(func=byUnion, arg1=flatten)
code_block_14 = CodeBlock(l=function_apply)
# ---------- code_block_14.designscript (12 lines) ----------
l;
[Imperative]
{
	if (l == null)
	{
		return = [];
	}
	else
	{
		return = l;
	}
};
# ----------------------------------------
byLoft = Surface.ByLoft()  # unwired: crossSections
code_block_15 = CodeBlock(x=code_block_12) { x[1]; }
flipNormalDirection = Surface.FlipNormalDirection(surface=code_block_15)
code_block_16 = CodeBlock { 0.5; }
normalAtParameter = Surface.NormalAtParameter(surface=flipNormalDirection, u=code_block_16, v=code_block_16)
code_block_17 = CodeBlock(x=code_block_12) { x[5]; }
translate = Geometry.Translate(geometry=flipNormalDirection, direction=normalAtParameter, distance=code_block_17)
perimeterCurves = Surface.PerimeterCurves(surface=translate)
flatten_2 = List.Flatten(list=perimeterCurves)
code_block_18 = CodeBlock { null; }
replaceEmptyLists = Custom[List.ReplaceEmptyLists](seq=flatten_2, Replacement=code_block_18)  # package Clockwork for Dynamo 2.x; Replaces all empty lists within a given list with a substitute
code_block_19 = CodeBlock(x=replaceEmptyLists)
# ---------- code_block_19.designscript (13 lines) ----------
x;

[Imperative]
{
	if (x == null)
	{
		return = [null,null,null];
	}
	else
	{
		return = x;
	}
};
# ----------------------------------------
code_block_20 = CodeBlock { [0,2]; }
getItemAtIndex = List.GetItemAtIndex(list=code_block_19.out1, index=code_block_20)
list_clean = Custom[List Clean](list=getItemAtIndex)  # package Genius Loci; Removes all Null, Empty and Blank from a list or nested list of lists.
code_block_21 = CodeBlock { 100000; }
extendEnd = Curve.ExtendEnd(curve=list_clean, distance=code_block_21)
code_block_22 = CodeBlock { 100000; }
extendStart = Curve.ExtendStart(curve=extendEnd, distance=code_block_22)
function_apply_2 = ApplyFunction(func=byLoft, arg1=extendStart)
intersect = Geometry.Intersect(geometry=code_block_14.out1, other=function_apply_2)
code_block_23 = CodeBlock { 0.5; }
pointAtParameter = Surface.PointAtParameter(surface=intersect, v=code_block_23)
code_block_24 = CodeBlock { 1; 0.5; }
pointAtParameter_2 = Surface.PointAtParameter(surface=intersect, u=code_block_24.out0, v=code_block_24.out1)
list_create_3 = List.Create(item0=pointAtParameter, item1=pointAtParameter_2)
flatten_3 = List.Flatten(list=list_create_3)
function_apply_3 = ApplyFunction(func=byBestFitThroughPoints, arg1=flatten_3)
code_block_25 = CodeBlock(l=function_apply_3)  # same code as code_block_14
direction = Line.Direction(line=code_block_25.out1)
Z = Vector.Z(vector=direction)
code_block_26 = CodeBlock { 0; }
lt = Z < code_block_26
reverse = Curve.Reverse(curve=code_block_25.out1)
if_ = If(test=lt, true=reverse, false=code_block_25.out1)
code_block_27 = CodeBlock(line1=if_) { curve1 = Autodesk.Curve.ExtendStart(line1, -50); curve2 = Autodesk.Curve.ExtendEnd(curve1, -20); }
code_block_28 = CodeBlock(x=code_block_12) { x[2]; }
code_block_29 = CodeBlock { 0.5; }
pointAtParameter_3 = Surface.PointAtParameter(surface=code_block_28, u=code_block_29, v=code_block_29)
byOriginNormal = Plane.ByOriginNormal(origin=pointAtParameter_3)
intersect_2 = Geometry.Intersect(geometry=code_block_27.curve2, other=byOriginNormal)
flatten_4 = List.Flatten(list=intersect_2)
splitByPoints = Curve.SplitByPoints(curve=code_block_27.curve2, points=flatten_4)
code_block_30 = CodeBlock(x=code_block_12) { x[1]; }
flipNormalDirection_2 = Surface.FlipNormalDirection(surface=code_block_30)
byBestFitThroughPoints_2 = Line.ByBestFitThroughPoints()  # unwired: bestFitPoints
code_block_31 = CodeBlock { 0.5; }
pointAtParameter_4 = Surface.PointAtParameter(surface=code_block_30, v=code_block_31)
code_block_32 = CodeBlock { 1; 0.5; }
pointAtParameter_5 = Surface.PointAtParameter(surface=code_block_30, u=code_block_32.out0, v=code_block_32.out1)
list_create_4 = List.Create(item0=pointAtParameter_4, item1=pointAtParameter_5)
flatten_5 = List.Flatten(list=list_create_4)
function_apply_4 = ApplyFunction(func=byBestFitThroughPoints_2, arg1=flatten_5)
code_block_33 = CodeBlock(l=function_apply_4)  # same code as code_block_14
code_block_34 = CodeBlock { 90; 0.5; }
planeAtParameter = Curve.PlaneAtParameter(curve=code_block_33.out1, param=code_block_34.out1)
rotate = Geometry.Rotate(geometry=flipNormalDirection_2, basePlane=planeAtParameter, degrees=code_block_34.out0)
code_block_35 = CodeBlock { 0.5; }
normalAtParameter_2 = Surface.NormalAtParameter(surface=rotate, u=code_block_35, v=code_block_35)
code_block_36 = CodeBlock(x=code_block_13) { x; }
getCategory = Element.GetCategory()  # unwired: element
function_apply_5 = ApplyFunction(func=getCategory, arg1=code_block_36)
string_from_object = FromObject(obj=function_apply_5)
code_block_37 = CodeBlock { "Walls"; }
eq = string_from_object == code_block_37
code_block_38 = CodeBlock(l=eq)
# ---------- code_block_38.designscript (12 lines) ----------
l;
[Imperative]
{
	if (l == false)
	{
		return = [];
	}
	else
	{
		return = l;
	}
};
# ----------------------------------------
filterByBoolMask = List.FilterByBoolMask(list=code_block_36, mask=code_block_38.out1)
geometry_2 = Element.Geometry(element=filterByBoolMask.in)
flatten_6 = List.Flatten(list=geometry_2)
code_block_39 = CodeBlock { 0.2; }
pointAtParameter_6 = Curve.PointAtParameter(curve=splitByPoints, param=code_block_39)
doesIntersect = Geometry.DoesIntersect(geometry=flatten_6@L1, other=pointAtParameter_6@L2, lacing=Longest)
o_list_anytrue = Orchid.Common.List.AnyTrue(list=doesIntersect)
filterByBoolMask_2 = List.FilterByBoolMask(list=filterByBoolMask.in, mask=o_list_anytrue)
code_block_40 = CodeBlock(t6=filterByBoolMask_2.in)
# ---------- code_block_40.designscript (6 lines) ----------
t4 = t6;
t2 = t4;
t1 = Revit.Elements.Element.GetParameterValueByName(t2, "Type");
t3 = Revit.Elements.Element.GetParameterValueByName(t1, "Width");
t5 = t3 / 2;
t7 = t5 - 40;
# ----------------------------------------
translate_2 = Geometry.Translate(geometry=splitByPoints, direction=normalAtParameter_2, distance=code_block_40.t7, lacing=Longest)
code_block_41 = CodeBlock(x=code_block_12) { x[3]; }
traslapo_armadura = CodeBlock(rebar=code_block_41)
# ---------- traslapo_armadura.designscript (5 lines) ----------
diametro_barra = Strings.ToString(Properties.RebarDiameter(rebar),"");
key = ["8","10","12","16","18","22","25","28","32","36"];
val = [570, 710, 860, 1140, 1290, 1960, 2230, 2500, 2850, 3210];
dict_traslapo = Dictionary.ByKeysValues(key, val);
t3 = Dictionary.ValueAtKey(dict_traslapo, diametro_barra);
# ----------------------------------------
extendEnd_2 = Curve.ExtendEnd(curve=translate_2, distance=traslapo_armadura.t3)
function_apply_6 = ApplyFunction(func=firstItem, arg1=extendEnd_2)
element_types_ᶜᵒⁿᵛᵉʳᵗᵉᵈ_ᵈʳᵒᵖᵈᵒʷⁿ_2 = CodeBlock { DSCore.Types.FindTypeByNameInAssembly("RebarHookType", "RevitAPI"); }
all_elements_of_type_2 = ElementsOfType(element_type=element_types_ᶜᵒⁿᵛᵉʳᵗᵉᵈ_ᵈʳᵒᵖᵈᵒʷⁿ_2)
rebar_hook_type_at_start = CodeBlock(t3=all_elements_of_type_2)
# ---------- rebar_hook_type_at_start.designscript (5 lines) ----------
t1 = t3;
str2 = Revit.Elements.Element.Name(t1);
t2 = str2 == "Standard - 90 deg.";
t4 = DSCore.List.FilterByBoolMask(t3, t2);
t5 = Dictionary.ValueAtKey(t4, "in");
# ----------------------------------------
direction_2 = Line.Direction(line=code_block_33.out1)
Z_2 = Vector.Z(vector=direction_2)
code_block_42 = CodeBlock { 0; }
lt_2 = Z_2 < code_block_42
code_block_43 = CodeBlock { "Left"; "Right"; }
if_2 = If(test=lt_2, true=code_block_43.out0, false=code_block_43.out1)
firstItem_2 = List.FirstItem()  # unwired: list
function_apply_7 = ApplyFunction(func=firstItem_2, arg1=filterByBoolMask_2.in)
reverse_2 = Vector.Reverse(vector=normalAtParameter_2)
code_block_44 = CodeBlock(curves=function_apply_6, rebarBarType=code_block_41, startHookType=rebar_hook_type_at_start.t5, startHookOrientation=if_2, endtHookOrientation=if_2, hostElement=function_apply_7, vector=reverse_2)
# ---------- code_block_44.designscript (18 lines) ----------
//curves
curves;
//rebarStyle
"Standard";
//rebarBarType
rebarBarType;
//startHookType
startHookType;
//endHookType
null;
//startHookOrientation
startHookOrientation;
//endtHookOrientation
endtHookOrientation;
//hostElement
hostElement;
//vector
vector;
# ----------------------------------------
fromCurves = StructuralDesign.Rebar.Create.FromCurves(curves=code_block_44.curves@L1, rebarStyle=code_block_44.out1@L1, rebarBarType=code_block_44.rebarBarType@L1, startHookType=code_block_44.startHookType@L1, endHookType=code_block_44.out4@L1, startHookOrientation=code_block_44.startHookOrientation@L1, endHookOrientation=code_block_44.endtHookOrientation@L1, hostElement=code_block_44.hostElement@L1, vector=code_block_44.vector@L1, lacing=Longest)
code_block_45 = CodeBlock { "Capa"; }
code_block_46 = CodeBlock(x=code_block_12) { x[5]; }
string_from_object_2 = FromObject(obj=code_block_46)
numero_de_capa = CodeBlock(capa=string_from_object_2)
# ---------- numero_de_capa.designscript (4 lines) ----------
key = ["40", "90", "140", "190", "240"];
val = ["1", "2", "3", "4", "5"];
dict_capa = Dictionary.ByKeysValues(key, val);
t3 = Dictionary.ValueAtKey(dict_capa, capa);
# ----------------------------------------
setParameterByName = Element.SetParameterByName(element=fromCurves, parameterName=code_block_45, value=numero_de_capa.t3)
code_block_47 = CodeBlock(t2=filterByBoolMask_2.in)
# ---------- code_block_47.designscript (3 lines) ----------
t1 = Revit.Elements.Element.GetParameterValueByName(t2, "Type");
t3 = Revit.Elements.Element.GetParameterValueByName(t1, "Width");
t4 = t3 - 80;
# ----------------------------------------
code_block_48 = CodeBlock(x=code_block_12) { x[4]; }
setLayoutAsFixedNumber = StructuralDesign.Rebar.Layout.SetLayoutAsFixedNumber(rebar=setParameterByName, arrayLength=code_block_47.t4, numberOfBarPositions=code_block_48)
element_types_ᶜᵒⁿᵛᵉʳᵗᵉᵈ_ᵈʳᵒᵖᵈᵒʷⁿ_3 = CodeBlock { DSCore.Types.FindTypeByNameInAssembly("RebarShape", "RevitAPI"); }
all_elements_of_type_3 = ElementsOfType(element_type=element_types_ᶜᵒⁿᵛᵉʳᵗᵉᵈ_ᵈʳᵒᵖᵈᵒʷⁿ_3)
code_block_49 = CodeBlock(t1=all_elements_of_type_3)
# ---------- code_block_49.designscript (5 lines) ----------
"Shape";
str2 = Revit.Elements.Element.Name(t1);
t2 = str2 == "R_S_01";
t3 = DSCore.List.FilterByBoolMask(t1, t2);
t4 = Dictionary.ValueAtKey(t3, "in");
# ----------------------------------------
setParameterByName_2 = Element.SetParameterByName(element=setLayoutAsFixedNumber, parameterName=code_block_49.out0, value=code_block_49.t4, lacing=Longest)
rebarCenterlineCurves = StructuralDesign.Rebar.Properties.RebarCenterlineCurves(rebar=setParameterByName_2)
flatten_7 = List.Flatten(list=rebarCenterlineCurves)
traslapo_armadura_2 = CodeBlock(capa=string_from_object_2)
# ---------- traslapo_armadura_2.designscript (4 lines) ----------
key = ["40", "90", "140", "190", "240"];
val = [0.8, 0.7, 0.6, 0.5, 0.4];
dict_capa = Dictionary.ByKeysValues(key, val);
t3 = Dictionary.ValueAtKey(dict_capa, capa);
# ----------------------------------------
pointAtParameter_7 = Curve.PointAtParameter(curve=flatten_7, param=traslapo_armadura_2.t3)
flatten_8 = List.Flatten(list=pointAtParameter_7)
code_block_50 = CodeBlock()
# ---------- code_block_50.designscript (4 lines) ----------
family1 = Revit.Family.ByName("EST_A_STRUCTURAL REBAR TAG_STANDAR");
familytype1 = Revit.Elements.FamilyType.ByFamilyAndName(family1, "R_S_01");
true;
true;
# ----------------------------------------
create_tag = Custom[Create Tag](view=o_document_activeview_2@L1, element=setParameterByName_2@L1, TagLocation=flatten_8@L1, TagType=code_block_50.familytype1@L1, addLeader=code_block_50.out2@L1, RunIt=code_block_50.out3@L1, lacing=Longest)  # package Genius Loci; Works only in Revit 2018 and later. Creates a tag at a given location, of given type and in a supplied view. The node also works with Linked Elements (except space and area), Multi Category tag and Material Tag. Based on an archilab node
flatten_9 = List.Flatten(list=create_tag)
code_block_51 = CodeBlock(x=code_block_12) { x[1]; }
code_block_52 = CodeBlock(x=code_block_51) { x; }
code_block_53 = CodeBlock { 0.5; }
normalAtParameter_3 = Surface.NormalAtParameter(surface=code_block_52, u=code_block_53, v=code_block_53)
code_block_54 = CodeBlock { 800; }
translate_3 = Geometry.Translate(geometry=code_block_52, direction=normalAtParameter_3, distance=code_block_54)
code_block_55 = CodeBlock { 0.5; }
pointAtParameter_8 = Surface.PointAtParameter(surface=translate_3, u=code_block_55, v=code_block_55)
byOriginNormal_2 = Plane.ByOriginNormal(origin=pointAtParameter_8, normal=normalAtParameter_3)
ꟿ_point_pullontoplane = Custom[ꟿ Point.PullOntoPlane](point=flatten_8, plane=byOriginNormal_2)  # package spring nodes; Pulls (projects) the point onto the input plane, following the plane normal.
tag_setlocation = Custom[Tag SetLocation](tag=flatten_9, location=ꟿ_point_pullontoplane)  # package Genius Loci; Moves the head of the tag to the given location point.
o_document_activeview_3 = Orchid.RevitProject.Common.Document.ActiveView()
byBestFitThroughPoints_3 = Line.ByBestFitThroughPoints()  # unwired: bestFitPoints
byUnion_2 = Solid.ByUnion()  # unwired: solids
code_block_56 = CodeBlock(x=code_block_11.out1) { x; }
code_block_57 = CodeBlock(x=code_block_56) { x[0]; }
geometry_3 = Element.Geometry(element=code_block_57)
flatten_10 = List.Flatten(list=geometry_3)
function_apply_8 = ApplyFunction(func=byUnion_2, arg1=flatten_10)
code_block_58 = CodeBlock(l=function_apply_8)  # same code as code_block_14
byLoft_2 = Surface.ByLoft()  # unwired: crossSections
code_block_59 = CodeBlock(x=code_block_56) { x[1]; }
flipNormalDirection_3 = Surface.FlipNormalDirection(surface=code_block_59)
code_block_60 = CodeBlock { 0.5; }
normalAtParameter_4 = Surface.NormalAtParameter(surface=flipNormalDirection_3, u=code_block_60, v=code_block_60)
code_block_61 = CodeBlock(x=code_block_56) { x[5]; }
translate_4 = Geometry.Translate(geometry=flipNormalDirection_3, direction=normalAtParameter_4, distance=code_block_61)
perimeterCurves_2 = Surface.PerimeterCurves(surface=translate_4)
flatten_11 = List.Flatten(list=perimeterCurves_2)
code_block_62 = CodeBlock { null; }
replaceEmptyLists_2 = Custom[List.ReplaceEmptyLists](seq=flatten_11, Replacement=code_block_62)
code_block_63 = CodeBlock(x=replaceEmptyLists_2)  # same code as code_block_19
code_block_64 = CodeBlock { [0,2]; }
getItemAtIndex_2 = List.GetItemAtIndex(list=code_block_63.out1, index=code_block_64)
list_clean_2 = Custom[List Clean](list=getItemAtIndex_2)
code_block_65 = CodeBlock { 100000; }
extendEnd_3 = Curve.ExtendEnd(curve=list_clean_2, distance=code_block_65)
code_block_66 = CodeBlock { 100000; }
extendStart_2 = Curve.ExtendStart(curve=extendEnd_3, distance=code_block_66)
function_apply_9 = ApplyFunction(func=byLoft_2, arg1=extendStart_2)
intersect_3 = Geometry.Intersect(geometry=code_block_58.out1, other=function_apply_9)
code_block_67 = CodeBlock { 0.5; }
pointAtParameter_9 = Surface.PointAtParameter(surface=intersect_3, v=code_block_67)
code_block_68 = CodeBlock { 1; 0.5; }
pointAtParameter_10 = Surface.PointAtParameter(surface=intersect_3, u=code_block_68.out0, v=code_block_68.out1)
list_create_5 = List.Create(item0=pointAtParameter_9, item1=pointAtParameter_10)
flatten_12 = List.Flatten(list=list_create_5)
function_apply_10 = ApplyFunction(func=byBestFitThroughPoints_3, arg1=flatten_12)
code_block_69 = CodeBlock(l=function_apply_10)  # same code as code_block_14
direction_3 = Line.Direction(line=code_block_69.out1)
Z_3 = Vector.Z(vector=direction_3)
code_block_70 = CodeBlock { 0; }
lt_3 = Z_3 < code_block_70
reverse_3 = Curve.Reverse(curve=code_block_69.out1)
if_3 = If(test=lt_3, true=reverse_3, false=code_block_69.out1)
code_block_71 = CodeBlock(line1=if_3) { curve1 = Autodesk.Curve.ExtendStart(line1, -50); curve2 = Autodesk.Curve.ExtendEnd(curve1, -20); }
code_block_72 = CodeBlock(x=code_block_56) { x[2]; }
code_block_73 = CodeBlock { 0.5; }
pointAtParameter_11 = Surface.PointAtParameter(surface=code_block_72, u=code_block_73, v=code_block_73)
byOriginNormal_3 = Plane.ByOriginNormal(origin=pointAtParameter_11)
intersect_4 = Geometry.Intersect(geometry=code_block_71.curve2, other=byOriginNormal_3)
flatten_13 = List.Flatten(list=intersect_4)
splitByPoints_2 = Curve.SplitByPoints(curve=code_block_71.curve2, points=flatten_13)
code_block_74 = CodeBlock(x=code_block_56) { x[1]; }
flipNormalDirection_4 = Surface.FlipNormalDirection(surface=code_block_74)
byBestFitThroughPoints_4 = Line.ByBestFitThroughPoints()  # unwired: bestFitPoints
code_block_75 = CodeBlock { 0.5; }
pointAtParameter_12 = Surface.PointAtParameter(surface=code_block_74, v=code_block_75)
code_block_76 = CodeBlock { 1; 0.5; }
pointAtParameter_13 = Surface.PointAtParameter(surface=code_block_74, u=code_block_76.out0, v=code_block_76.out1)
list_create_6 = List.Create(item0=pointAtParameter_12, item1=pointAtParameter_13)
flatten_14 = List.Flatten(list=list_create_6)
function_apply_11 = ApplyFunction(func=byBestFitThroughPoints_4, arg1=flatten_14)
code_block_77 = CodeBlock(l=function_apply_11)  # same code as code_block_14
code_block_78 = CodeBlock { 90; 0.5; }
planeAtParameter_2 = Curve.PlaneAtParameter(curve=code_block_77.out1, param=code_block_78.out1)
rotate_2 = Geometry.Rotate(geometry=flipNormalDirection_4, basePlane=planeAtParameter_2, degrees=code_block_78.out0)
code_block_79 = CodeBlock { 0.5; }
normalAtParameter_5 = Surface.NormalAtParameter(surface=rotate_2, u=code_block_79, v=code_block_79)
code_block_80 = CodeBlock(x=code_block_57) { x; }
getCategory_2 = Element.GetCategory()  # unwired: element
function_apply_12 = ApplyFunction(func=getCategory_2, arg1=code_block_80)
string_from_object_3 = FromObject(obj=function_apply_12)
code_block_81 = CodeBlock { "Walls"; }
eq_2 = string_from_object_3 == code_block_81
code_block_82 = CodeBlock(l=eq_2)  # same code as code_block_38
filterByBoolMask_3 = List.FilterByBoolMask(list=code_block_80, mask=code_block_82.out1)
geometry_4 = Element.Geometry(element=filterByBoolMask_3.in)
flatten_15 = List.Flatten(list=geometry_4)
code_block_83 = CodeBlock { 0.2; }
pointAtParameter_14 = Curve.PointAtParameter(curve=splitByPoints_2, param=code_block_83)
doesIntersect_2 = Geometry.DoesIntersect(geometry=flatten_15@L1, other=pointAtParameter_14@L2, lacing=Longest)
o_list_anytrue_2 = Orchid.Common.List.AnyTrue(list=doesIntersect_2)
filterByBoolMask_4 = List.FilterByBoolMask(list=filterByBoolMask_3.in, mask=o_list_anytrue_2)
code_block_84 = CodeBlock(t6=filterByBoolMask_4.in)  # same code as code_block_40
translate_5 = Geometry.Translate(geometry=splitByPoints_2, direction=normalAtParameter_5, distance=code_block_84.t7, lacing=Longest)
code_block_85 = CodeBlock(x=code_block_56) { x[3]; }
traslapo_armadura_3 = CodeBlock(rebar=code_block_85)  # same code as traslapo_armadura
extendEnd_4 = Curve.ExtendEnd(curve=translate_5, distance=traslapo_armadura_3.t3)
ꟿ_list_dropfirstlast = Custom[ꟿ List.DropFirstLast](list=extendEnd_4)  # package spring nodes; Removes the first and last items from the list
direction_4 = Line.Direction(line=code_block_77.out1)
Z_4 = Vector.Z(vector=direction_4)
code_block_86 = CodeBlock { 0; }
lt_4 = Z_4 < code_block_86
code_block_87 = CodeBlock { "Left"; "Right"; }
if_4 = If(test=lt_4, true=code_block_87.out0, false=code_block_87.out1)
ꟿ_list_dropfirstlast_2 = Custom[ꟿ List.DropFirstLast](list=filterByBoolMask_4.in)
reverse_4 = Vector.Reverse(vector=normalAtParameter_5)
code_block_88 = CodeBlock(curves=ꟿ_list_dropfirstlast.rest, rebarBarType=code_block_85, startHookOrientation=if_4, endtHookOrientation=if_4, hostElement=ꟿ_list_dropfirstlast_2.rest, vector=reverse_4)
# ---------- code_block_88.designscript (18 lines) ----------
//curves
curves;
//rebarStyle
"Standard";
//rebarBarType
rebarBarType;
//startHookType
null;
//endHookType
null;
//startHookOrientation
startHookOrientation;
//endtHookOrientation
endtHookOrientation;
//hostElement
hostElement;
//vector
vector;
# ----------------------------------------
fromCurves_2 = StructuralDesign.Rebar.Create.FromCurves(curves=code_block_88.curves@L1, rebarStyle=code_block_88.out1@L1, rebarBarType=code_block_88.rebarBarType@L1, startHookType=code_block_88.out3@L1, endHookType=code_block_88.out4@L1, startHookOrientation=code_block_88.startHookOrientation@L1, endHookOrientation=code_block_88.endtHookOrientation@L1, hostElement=code_block_88.hostElement@L1, vector=code_block_88.vector@L1, lacing=Longest)
code_block_89 = CodeBlock { "Capa"; }
code_block_90 = CodeBlock(x=code_block_56) { x[5]; }
string_from_object_4 = FromObject(obj=code_block_90)
numero_de_capa_2 = CodeBlock(capa=string_from_object_4)  # same code as numero_de_capa
setParameterByName_3 = Element.SetParameterByName(element=fromCurves_2, parameterName=code_block_89, value=numero_de_capa_2.t3)
code_block_91 = CodeBlock(t2=filterByBoolMask_4.in)  # same code as code_block_47
code_block_92 = CodeBlock(x=code_block_56) { x[4]; }
setLayoutAsFixedNumber_2 = StructuralDesign.Rebar.Layout.SetLayoutAsFixedNumber(rebar=setParameterByName_3, arrayLength=code_block_91.t4, numberOfBarPositions=code_block_92)
element_types_ᶜᵒⁿᵛᵉʳᵗᵉᵈ_ᵈʳᵒᵖᵈᵒʷⁿ_4 = CodeBlock { DSCore.Types.FindTypeByNameInAssembly("RebarShape", "RevitAPI"); }
all_elements_of_type_4 = ElementsOfType(element_type=element_types_ᶜᵒⁿᵛᵉʳᵗᵉᵈ_ᵈʳᵒᵖᵈᵒʷⁿ_4)
code_block_93 = CodeBlock(t1=all_elements_of_type_4)
# ---------- code_block_93.designscript (5 lines) ----------
"Shape";
str2 = Revit.Elements.Element.Name(t1);
t2 = str2 == "R_S_00";
t3 = DSCore.List.FilterByBoolMask(t1, t2);
t4 = Dictionary.ValueAtKey(t3, "in");
# ----------------------------------------
setParameterByName_4 = Element.SetParameterByName(element=setLayoutAsFixedNumber_2, parameterName=code_block_93.out0, value=code_block_93.t4, lacing=Longest)
rebarCenterlineCurves_2 = StructuralDesign.Rebar.Properties.RebarCenterlineCurves(rebar=setParameterByName_4)
traslapo_armadura_4 = CodeBlock(capa=string_from_object_4)  # same code as traslapo_armadura_2
pointAtParameter_15 = Curve.PointAtParameter(curve=rebarCenterlineCurves_2, param=traslapo_armadura_4.t3)
flatten_16 = List.Flatten(list=pointAtParameter_15)
code_block_94 = CodeBlock()
# ---------- code_block_94.designscript (4 lines) ----------
family1 = Revit.Family.ByName("EST_A_STRUCTURAL REBAR TAG_STANDAR");
familytype1 = Revit.Elements.FamilyType.ByFamilyAndName(family1, "R_S_00");
true;
true;
# ----------------------------------------
create_tag_2 = Custom[Create Tag](view=o_document_activeview_3@L1, element=setParameterByName_4@L1, TagLocation=flatten_16@L1, TagType=code_block_94.familytype1@L1, addLeader=code_block_94.out2@L1, RunIt=code_block_94.out3@L1, lacing=Longest)
flatten_17 = List.Flatten(list=create_tag_2)
code_block_95 = CodeBlock(x=code_block_56) { x[1]; }
code_block_96 = CodeBlock(x=code_block_95) { x; }
code_block_97 = CodeBlock { 0.5; }
normalAtParameter_6 = Surface.NormalAtParameter(surface=code_block_96, u=code_block_97, v=code_block_97)
code_block_98 = CodeBlock { 800; }
translate_6 = Geometry.Translate(geometry=code_block_96, direction=normalAtParameter_6, distance=code_block_98)
code_block_99 = CodeBlock { 0.5; }
pointAtParameter_16 = Surface.PointAtParameter(surface=translate_6, u=code_block_99, v=code_block_99)
byOriginNormal_4 = Plane.ByOriginNormal(origin=pointAtParameter_16, normal=normalAtParameter_6)
ꟿ_point_pullontoplane_2 = Custom[ꟿ Point.PullOntoPlane](point=flatten_16, plane=byOriginNormal_4, lacing=Longest)
tag_setlocation_2 = Custom[Tag SetLocation](tag=flatten_17, location=ꟿ_point_pullontoplane_2)
o_document_activeview_4 = Orchid.RevitProject.Common.Document.ActiveView()
lastItem = List.LastItem()  # unwired: list
byBestFitThroughPoints_5 = Line.ByBestFitThroughPoints()  # unwired: bestFitPoints
byUnion_3 = Solid.ByUnion()  # unwired: solids
code_block_100 = CodeBlock(x=code_block_11.out1) { x; }
code_block_101 = CodeBlock(x=code_block_100) { x[0]; }
geometry_5 = Element.Geometry(element=code_block_101)
flatten_18 = List.Flatten(list=geometry_5)
function_apply_13 = ApplyFunction(func=byUnion_3, arg1=flatten_18)
code_block_102 = CodeBlock(l=function_apply_13)  # same code as code_block_14
byLoft_3 = Surface.ByLoft()  # unwired: crossSections
code_block_103 = CodeBlock(x=code_block_100) { x[1]; }
flipNormalDirection_5 = Surface.FlipNormalDirection(surface=code_block_103)
code_block_104 = CodeBlock { 0.5; }
normalAtParameter_7 = Surface.NormalAtParameter(surface=flipNormalDirection_5, u=code_block_104, v=code_block_104)
code_block_105 = CodeBlock(x=code_block_100) { x[5]; }
translate_7 = Geometry.Translate(geometry=flipNormalDirection_5, direction=normalAtParameter_7, distance=code_block_105)
perimeterCurves_3 = Surface.PerimeterCurves(surface=translate_7)
flatten_19 = List.Flatten(list=perimeterCurves_3)
code_block_106 = CodeBlock { null; }
replaceEmptyLists_3 = Custom[List.ReplaceEmptyLists](seq=flatten_19, Replacement=code_block_106)
code_block_107 = CodeBlock(x=replaceEmptyLists_3)  # same code as code_block_19
code_block_108 = CodeBlock { [0,2]; }
getItemAtIndex_3 = List.GetItemAtIndex(list=code_block_107.out1, index=code_block_108)
list_clean_3 = Custom[List Clean](list=getItemAtIndex_3)
code_block_109 = CodeBlock { 100000; }
extendEnd_5 = Curve.ExtendEnd(curve=list_clean_3, distance=code_block_109)
code_block_110 = CodeBlock { 100000; }
extendStart_3 = Curve.ExtendStart(curve=extendEnd_5, distance=code_block_110)
function_apply_14 = ApplyFunction(func=byLoft_3, arg1=extendStart_3)
intersect_5 = Geometry.Intersect(geometry=code_block_102.out1, other=function_apply_14)
code_block_111 = CodeBlock { 0.5; }
pointAtParameter_17 = Surface.PointAtParameter(surface=intersect_5, v=code_block_111)
code_block_112 = CodeBlock { 1; 0.5; }
pointAtParameter_18 = Surface.PointAtParameter(surface=intersect_5, u=code_block_112.out0, v=code_block_112.out1)
list_create_7 = List.Create(item0=pointAtParameter_17, item1=pointAtParameter_18)
flatten_20 = List.Flatten(list=list_create_7)
function_apply_15 = ApplyFunction(func=byBestFitThroughPoints_5, arg1=flatten_20)
code_block_113 = CodeBlock(l=function_apply_15)  # same code as code_block_14
direction_5 = Line.Direction(line=code_block_113.out1)
Z_5 = Vector.Z(vector=direction_5)
code_block_114 = CodeBlock { 0; }
lt_5 = Z_5 < code_block_114
reverse_5 = Curve.Reverse(curve=code_block_113.out1)
if_5 = If(test=lt_5, true=reverse_5, false=code_block_113.out1)
code_block_115 = CodeBlock(line1=if_5) { curve1 = Autodesk.Curve.ExtendStart(line1, -50); curve2 = Autodesk.Curve.ExtendEnd(curve1, -20); }
code_block_116 = CodeBlock(x=code_block_100) { x[2]; }
code_block_117 = CodeBlock { 0.5; }
pointAtParameter_19 = Surface.PointAtParameter(surface=code_block_116, u=code_block_117, v=code_block_117)
byOriginNormal_5 = Plane.ByOriginNormal(origin=pointAtParameter_19)
intersect_6 = Geometry.Intersect(geometry=code_block_115.curve2, other=byOriginNormal_5)
flatten_21 = List.Flatten(list=intersect_6)
splitByPoints_3 = Curve.SplitByPoints(curve=code_block_115.curve2, points=flatten_21)
code_block_118 = CodeBlock(x=code_block_100) { x[1]; }
flipNormalDirection_6 = Surface.FlipNormalDirection(surface=code_block_118)
byBestFitThroughPoints_6 = Line.ByBestFitThroughPoints()  # unwired: bestFitPoints
code_block_119 = CodeBlock { 0.5; }
pointAtParameter_20 = Surface.PointAtParameter(surface=code_block_118, v=code_block_119)
code_block_120 = CodeBlock { 1; 0.5; }
pointAtParameter_21 = Surface.PointAtParameter(surface=code_block_118, u=code_block_120.out0, v=code_block_120.out1)
list_create_8 = List.Create(item0=pointAtParameter_20, item1=pointAtParameter_21)
flatten_22 = List.Flatten(list=list_create_8)
function_apply_16 = ApplyFunction(func=byBestFitThroughPoints_6, arg1=flatten_22)
code_block_121 = CodeBlock(l=function_apply_16)  # same code as code_block_14
code_block_122 = CodeBlock { 90; 0.5; }
planeAtParameter_3 = Curve.PlaneAtParameter(curve=code_block_121.out1, param=code_block_122.out1)
rotate_3 = Geometry.Rotate(geometry=flipNormalDirection_6, basePlane=planeAtParameter_3, degrees=code_block_122.out0)
code_block_123 = CodeBlock { 0.5; }
normalAtParameter_8 = Surface.NormalAtParameter(surface=rotate_3, u=code_block_123, v=code_block_123)
code_block_124 = CodeBlock(x=code_block_101) { x; }
getCategory_3 = Element.GetCategory()  # unwired: element
function_apply_17 = ApplyFunction(func=getCategory_3, arg1=code_block_124)
string_from_object_5 = FromObject(obj=function_apply_17)
code_block_125 = CodeBlock { "Walls"; }
eq_3 = string_from_object_5 == code_block_125
code_block_126 = CodeBlock(l=eq_3)  # same code as code_block_38
filterByBoolMask_5 = List.FilterByBoolMask(list=code_block_124, mask=code_block_126.out1)
geometry_6 = Element.Geometry(element=filterByBoolMask_5.in)
flatten_23 = List.Flatten(list=geometry_6)
code_block_127 = CodeBlock { 0.2; }
pointAtParameter_22 = Curve.PointAtParameter(curve=splitByPoints_3, param=code_block_127)
doesIntersect_3 = Geometry.DoesIntersect(geometry=flatten_23@L1, other=pointAtParameter_22@L2, lacing=Longest)
o_list_anytrue_3 = Orchid.Common.List.AnyTrue(list=doesIntersect_3)
filterByBoolMask_6 = List.FilterByBoolMask(list=filterByBoolMask_5.in, mask=o_list_anytrue_3)
code_block_128 = CodeBlock(t6=filterByBoolMask_6.in)  # same code as code_block_40
translate_8 = Geometry.Translate(geometry=splitByPoints_3, direction=normalAtParameter_8, distance=code_block_128.t7, lacing=Longest)
function_apply_18 = ApplyFunction(func=lastItem, arg1=translate_8)
code_block_129 = CodeBlock(x=code_block_100) { x[3]; }
element_types_ᶜᵒⁿᵛᵉʳᵗᵉᵈ_ᵈʳᵒᵖᵈᵒʷⁿ_5 = CodeBlock { DSCore.Types.FindTypeByNameInAssembly("RebarHookType", "RevitAPI"); }
all_elements_of_type_5 = ElementsOfType(element_type=element_types_ᶜᵒⁿᵛᵉʳᵗᵉᵈ_ᵈʳᵒᵖᵈᵒʷⁿ_5)
rebar_hook_type_at_start_2 = CodeBlock(t3=all_elements_of_type_5)  # same code as rebar_hook_type_at_start
direction_6 = Line.Direction(line=code_block_121.out1)
Z_6 = Vector.Z(vector=direction_6)
code_block_130 = CodeBlock { 0; }
lt_6 = Z_6 < code_block_130
code_block_131 = CodeBlock { "Left"; "Right"; }
if_6 = If(test=lt_6, true=code_block_131.out0, false=code_block_131.out1)
lastItem_2 = List.LastItem()  # unwired: list
function_apply_19 = ApplyFunction(func=lastItem_2, arg1=filterByBoolMask_6.in)
reverse_6 = Vector.Reverse(vector=normalAtParameter_8)
code_block_132 = CodeBlock(curves=function_apply_18, rebarBarType=code_block_129, endHookType=rebar_hook_type_at_start_2.t5, startHookOrientation=if_6, endtHookOrientation=if_6, hostElement=function_apply_19, vector=reverse_6)
# ---------- code_block_132.designscript (18 lines) ----------
//curves
curves;
//rebarStyle
"Standard";
//rebarBarType
rebarBarType;
//startHookType
null;
//endHookType
endHookType;
//startHookOrientation
startHookOrientation;
//endtHookOrientation
endtHookOrientation;
//hostElement
hostElement;
//vector
vector;
# ----------------------------------------
fromCurves_3 = StructuralDesign.Rebar.Create.FromCurves(curves=code_block_132.curves@L1, rebarStyle=code_block_132.out1@L1, rebarBarType=code_block_132.rebarBarType@L1, startHookType=code_block_132.out3@L1, endHookType=code_block_132.endHookType@L1, startHookOrientation=code_block_132.startHookOrientation@L1, endHookOrientation=code_block_132.endtHookOrientation@L1, hostElement=code_block_132.hostElement@L1, vector=code_block_132.vector@L1, lacing=Longest)
code_block_133 = CodeBlock { "Capa"; }
code_block_134 = CodeBlock(x=code_block_100) { x[5]; }
string_from_object_6 = FromObject(obj=code_block_134)
numero_de_capa_3 = CodeBlock(capa=string_from_object_6)  # same code as numero_de_capa
setParameterByName_5 = Element.SetParameterByName(element=fromCurves_3, parameterName=code_block_133, value=numero_de_capa_3.t3)
code_block_135 = CodeBlock(t2=filterByBoolMask_6.in)  # same code as code_block_47
code_block_136 = CodeBlock(x=code_block_100) { x[4]; }
setLayoutAsFixedNumber_3 = StructuralDesign.Rebar.Layout.SetLayoutAsFixedNumber(rebar=setParameterByName_5, arrayLength=code_block_135.t4, numberOfBarPositions=code_block_136)
element_types_ᶜᵒⁿᵛᵉʳᵗᵉᵈ_ᵈʳᵒᵖᵈᵒʷⁿ_6 = CodeBlock { DSCore.Types.FindTypeByNameInAssembly("RebarShape", "RevitAPI"); }
all_elements_of_type_6 = ElementsOfType(element_type=element_types_ᶜᵒⁿᵛᵉʳᵗᵉᵈ_ᵈʳᵒᵖᵈᵒʷⁿ_6)
code_block_137 = CodeBlock(t1=all_elements_of_type_6)  # same code as code_block_49
setParameterByName_6 = Element.SetParameterByName(element=setLayoutAsFixedNumber_3, parameterName=code_block_137.out0, value=code_block_137.t4, lacing=Longest)
rebarCenterlineCurves_3 = StructuralDesign.Rebar.Properties.RebarCenterlineCurves(rebar=setParameterByName_6)
traslapo_armadura_5 = CodeBlock(capa=string_from_object_6)  # same code as traslapo_armadura_2
pointAtParameter_23 = Curve.PointAtParameter(curve=rebarCenterlineCurves_3, param=traslapo_armadura_5.t3)
flatten_24 = List.Flatten(list=pointAtParameter_23)
code_block_138 = CodeBlock()  # same code as code_block_50
create_tag_3 = Custom[Create Tag](view=o_document_activeview_4@L1, element=setParameterByName_6@L1, TagLocation=flatten_24@L1, TagType=code_block_138.familytype1@L1, addLeader=code_block_138.out2@L1, RunIt=code_block_138.out3@L1, lacing=Longest)
flatten_25 = List.Flatten(list=create_tag_3)
code_block_139 = CodeBlock(x=code_block_100) { x[1]; }
code_block_140 = CodeBlock(x=code_block_139) { x; }
code_block_141 = CodeBlock { 0.5; }
normalAtParameter_9 = Surface.NormalAtParameter(surface=code_block_140, u=code_block_141, v=code_block_141)
code_block_142 = CodeBlock { 800; }
translate_9 = Geometry.Translate(geometry=code_block_140, direction=normalAtParameter_9, distance=code_block_142)
code_block_143 = CodeBlock { 0.5; }
pointAtParameter_24 = Surface.PointAtParameter(surface=translate_9, u=code_block_143, v=code_block_143)
byOriginNormal_6 = Plane.ByOriginNormal(origin=pointAtParameter_24, normal=normalAtParameter_9)
ꟿ_point_pullontoplane_3 = Custom[ꟿ Point.PullOntoPlane](point=flatten_24, plane=byOriginNormal_6)
tag_setlocation_3 = Custom[Tag SetLocation](tag=flatten_25, location=ꟿ_point_pullontoplane_3)
list_create_9 = List.Create(item0=tag_setlocation, item1=tag_setlocation_2, item2=tag_setlocation_3)
flatten_26 = List.Flatten(list=list_create_9)
taggedElement = Tag.TaggedElement(tag=flatten_26)
rebarCenterlineCurves_4 = StructuralDesign.Rebar.Properties.RebarCenterlineCurves(rebar=taggedElement)
flatten_27 = List.Flatten(list=rebarCenterlineCurves_4)
intersect_7 = Geometry.Intersect(geometry=flatten_27@L1, other=flatten_27@L2, lacing=Longest)
flatten_28 = List.Flatten(list=intersect_7)
length = Curve.Length(curve=flatten_28)
code_block_144 = CodeBlock { [570, 710, 860, 1140, 1290, 1960, 2230, 2500, 2850, 3210]; }
eq_4 = length@L1 == code_block_144@L2  # lacing=Longest
o_list_anytrue_4 = Orchid.Common.List.AnyTrue(list=eq_4@L2)
filterByBoolMask_7 = List.FilterByBoolMask(list=flatten_28, mask=o_list_anytrue_4)
pruneDuplicates = Custom[Geometry.PruneDuplicates](GeometryList=filterByBoolMask_7.in)  # package Data-Shapes; Removes all duplicate geometries from list.
o_document_activeview_5 = Orchid.RevitProject.Common.Document.ActiveView()
plane = Custom[View.Plane](view=o_document_activeview_5)  # package Clockwork for Dynamo 2.x; Retrieves the plane of a given view
pullOntoPlane = Curve.PullOntoPlane(curve=pruneDuplicates, plane=plane)
family_types_ᶜᵒⁿᵛᵉʳᵗᵉᵈ_ᵈʳᵒᵖᵈᵒʷⁿ = CodeBlock { Revit.Elements.FamilyType.ByName("EST_D_DEATIL ITEM_EMPALME"); }
o_document_activeview_6 = Orchid.RevitProject.Common.Document.ActiveView()
byCurve = Custom[DetailComponent.ByCurve](curve=pullOntoPlane, familyType=family_types_ᶜᵒⁿᵛᵉʳᵗᵉᵈ_ᵈʳᵒᵖᵈᵒʷⁿ, view=o_document_activeview_6)  # package Clockwork for Dynamo 2.x; Places a line-based detail component in a given view
end = Revit.Transaction.Transaction.End(input=byCurve)
familyinstance_2d_geometry = Custom[FamilyInstance 2D Geometry](element=end)  # package Genius Loci; Gets the curves of the family instance. Works only with the family categories : Generic Annotation and Detail Item.
byJoinedCurves = PolyCurve.ByJoinedCurves(curves=familyinstance_2d_geometry)
byPatch = Surface.ByPatch(closedCurve=byJoinedCurves)
code_block_145 = CodeBlock { [1, 0]; [0.5, 0.5]; }
pointAtParameter_25 = Surface.PointAtParameter(surface=byPatch@L2, u=code_block_145.out0, v=code_block_145.out1, lacing=Longest)
transpose = List.Transpose(lists=pointAtParameter_25)
byBestFitThroughPoints_7 = Line.ByBestFitThroughPoints(bestFitPoints=transpose)
code_block_146 = CodeBlock(x=code_block_11.out1) { x[1]; }
code_block_147 = CodeBlock(x=code_block_146) { x; }
code_block_148 = CodeBlock { 0.5; }
normalAtParameter_10 = Surface.NormalAtParameter(surface=code_block_147, u=code_block_148, v=code_block_148)
code_block_149 = CodeBlock { 200; }
translate_10 = Geometry.Translate(geometry=code_block_147, direction=normalAtParameter_10, distance=code_block_149)
code_block_150 = CodeBlock { 0.5; }
pointAtParameter_26 = Surface.PointAtParameter(surface=translate_10, u=code_block_150, v=code_block_150)
byOriginNormal_7 = Plane.ByOriginNormal(origin=pointAtParameter_26, normal=normalAtParameter_10)
pullOntoPlane_2 = Curve.PullOntoPlane(curve=byBestFitThroughPoints_7, plane=byOriginNormal_7)
code_block_151 = CodeBlock { "Right"; }
familyinstance_reference_byname = Custom[FamilyInstance Reference ByName](familyInstance=end, name=code_block_151)  # package Genius Loci; Works only in Revit 2018.1 and later. Gets the reference corresponding to the named reference plane in the instance's family.
code_block_152 = CodeBlock { "Left"; }
familyinstance_reference_byname_2 = Custom[FamilyInstance Reference ByName](familyInstance=end, name=code_block_152)
list_create_10 = List.Create(item0=familyinstance_reference_byname.Reference, item1=familyinstance_reference_byname_2.Reference)
transpose_2 = List.Transpose(lists=list_create_10)
element_types_ᶜᵒⁿᵛᵉʳᵗᵉᵈ_ᵈʳᵒᵖᵈᵒʷⁿ_7 = CodeBlock { DSCore.Types.FindTypeByNameInAssembly("DimensionType", "RevitAPI"); }
all_elements_of_type_7 = ElementsOfType(element_type=element_types_ᶜᵒⁿᵛᵉʳᵗᵉᵈ_ᵈʳᵒᵖᵈᵒʷⁿ_7)
name = Element.Name(element=all_elements_of_type_7)
code_block_153 = CodeBlock { "Linear - 2.5mm Arial"; }
eq_5 = name == code_block_153
filterByBoolMask_8 = List.FilterByBoolMask(list=all_elements_of_type_7, mask=eq_5)
dimension_byreferences = Custom[Dimension ByReferences](view=o_document_activeview@L1, line=pullOntoPlane_2@L1, references=transpose_2@L2, dimensionType=filterByBoolMask_8.in@L1, lacing=Longest)  # package Genius Loci; Creates a new linear dimension from at least two geometric references of an object.
