# Dynamo graph corchete_multisegmento_script.dyn (Dynamo 2.6.2.15705)
# packages: Data-Shapes 2022.2.103, Structural Design 2021.1.22, Genius Loci 2021.11.10, Orchid 206.3.0.8161, Clockwork for Dynamo 2.x 2.4.0, spring nodes 210.1.1

code_block = CodeBlock { "Corchete Multisegmento"; }
file_path = Filename("..\..\..\..\..\..\..\..\..\..\Arainco\Arainco.png")
code_block_2 = CodeBlock { "INICIAR"; "CANCELAR"; true; 430; 170; 650; }
categories_ᶜᵒⁿᵛᵉʳᵗᵉᵈ_ᵈʳᵒᵖᵈᵒʷⁿ = CodeBlock { "Seleccionar Muros a Armar"; "SELECCIONAR"; Revit.Category.ByName(["Walls","Structural Foundations"]); }
selectmodelelements_data = Custom[SelectModelElements Data](InputName=categories_ᶜᵒⁿᵛᵉʳᵗᵉᵈ_ᵈʳᵒᵖᵈᵒʷⁿ.out0, ButtonText=categories_ᶜᵒⁿᵛᵉʳᵗᵉᵈ_ᵈʳᵒᵖᵈᵒʷⁿ.out1, CategoryFilter=categories_ᶜᵒⁿᵛᵉʳᵗᵉᵈ_ᵈʳᵒᵖᵈᵒʷⁿ.out2)  # package Data-Shapes; Creates a Revit element selection input for UI.MultipleInputForm++ . Check out www.data-shapes.net for more infos!
code_block_3 = CodeBlock { "Seleccionar Cara de\nDistribucion"; "SELECCIONAR"; }
selectfaces_data = Custom[SelectFaces Data](InputName=code_block_3.out0, ButtonText=code_block_3.out1)  # package Data-Shapes; Creates a Revit face selection input for UI.MultipleInputForm++. Check out www.data-shapes.net for more infos!
code_block_4 = CodeBlock { "Puntos de Empalme"; "SELECCIONAR"; }
selectfaces_data_2 = Custom[SelectFaces Data](InputName=code_block_4.out0, ButtonText=code_block_4.out1)
code_block_5 = CodeBlock { "Datos de Armadura"; }
code_block_6 = CodeBlock { "Diametro"; }
element_types_ᶜᵒⁿᵛᵉʳᵗᵉᵈ_ᵈʳᵒᵖᵈᵒʷⁿ = CodeBlock { DSCore.Types.FindTypeByNameInAssembly("RebarBarType", "RevitAPI"); }
all_elements_of_type = ElementsOfType(element_type=element_types_ᶜᵒⁿᵛᵉʳᵗᵉᵈ_ᵈʳᵒᵖᵈᵒʷⁿ)
code_block_7 = CodeBlock(t5=all_elements_of_type)
# ---------- code_block_7.designscript (8 lines) ----------
t4 = t5;
t1 = t4;
num1 = Properties.RebarDiameter(t1);
t2 = DSCore.List.SortByKey(t1, num1);
t3 = Dictionary.ValueAtKey(t2, "sorted list");
str1 = Revit.Elements.Element.Name(t3);
0;
false;
# ----------------------------------------
dropdown_data = Custom[DropDown Data](InputName=code_block_6, Keys=code_block_7.str1, Values=code_block_7.t3, DefaultValueIndex=code_block_7.out6, Sorted_optional=code_block_7.out7)  # package Data-Shapes; Create data for DropDown input in UI.MultiInputForm ++ . Check out www.data-shapes.net for more infos.
code_block_8 = CodeBlock { "Cantidad de Barras"; "2"; true; }
textbox_data = Custom[TextBox Data](InputName=code_block_8.out0, DefaultText=code_block_8.out1, IsNumberEntry=code_block_8.out2)  # package Data-Shapes; Create Data for TextBox input in UI.MultipleInputForm ++ . Check out www.data-shapes.net for more informations
code_block_9 = CodeBlock { "Capa"; ["1ª Capa", "2ª Capa", "3ª Capa", "4ª Capa", "5ª Capa"]; [40, 140, 240, 340, 440]; 0; }
dropdown_data_2 = Custom[DropDown Data](InputName=code_block_9.out0, Keys=code_block_9.out1, Values=code_block_9.out2, DefaultValueIndex=code_block_9.out3)
list_create = List.Create(item0=dropdown_data, item1=textbox_data, item2=dropdown_data_2)
inputgroup_data = Custom[InputGroup Data](GroupTitle=code_block_5, Inputs=list_create)  # package Data-Shapes; Creates a group of inputs for UI.MultipleInputForm ++ . Check out www.data-shapes.net for more infos !
list_create_2 = List.Create(item0=selectmodelelements_data, item1=selectfaces_data, item2=selectfaces_data_2, item3=inputgroup_data)
multipleinputform = Custom[MultipleInputForm ++](Description_optional=code_block, Logo_optional=file_path, ButtonText_optional=code_block_2.out0, Inputs=list_create_2, Toggle=code_block_2.out2, CancelButtonText_optional=code_block_2.out1, MaxHeight_optional=code_block_2.out5, Width_optional=code_block_2.out3, LabelWidth_optional=code_block_2.out4)  # package Data-Shapes; Create a form with multiple inputs. see www.data-shapes.net for tutorials and infos!
code_block_10 = CodeBlock(l=multipleinputform.User_Inputs)
# ---------- code_block_10.designscript (12 lines) ----------
l;
[Imperative]
{
	if (l == null)
	{
		return = [[],[],[],[],[],[],[]];
	}
	else
	{
		return = l;
	}
};
# ----------------------------------------
code_block_11 = CodeBlock(x=code_block_10.out1) { x; }
code_block_12 = CodeBlock(tip_barra=code_block_11) { tip_barra[3]; }
code_block_13 = CodeBlock(muros=code_block_11) { muros[0]; }
o_document_activeview = Orchid.RevitProject.Common.Document.ActiveView()
byBestFitThroughPoints = Line.ByBestFitThroughPoints()  # unwired: bestFitPoints
code_block_14 = CodeBlock(muros=code_block_11) { muros[0]; }
solidos_de_muros_seleccionados = CodeBlock(muros=code_block_14)
# ---------- solidos_de_muros_seleccionados.designscript (6 lines) ----------
elem_geom = Revit.Elements.Element.Geometry(muros);
elem_geom_flat = DSCore.List.Flatten(elem_geom, -1);
centroid_geom = Autodesk.Solid.Centroid(elem_geom_flat);
plane = Autodesk.Plane.ByOriginNormal(centroid_geom, Autodesk.Vector.ZAxis());
elem_geom_scaled = Autodesk.Geometry.Scale(elem_geom_flat, plane, 1, 5, 1);
elem_geom_union = Autodesk.Solid.ByUnion(elem_geom_scaled);
# ----------------------------------------
to_empty_list = Python(IN[0]=solidos_de_muros_seleccionados.elem_geom_union)
# ---------- to_empty_list.python (9 lines) ----------
var = IN[0]
lst = None

if var == lst:
	x = [] 
else:
	x = var

OUT = x
# ----------------------------------------
code_block_15 = CodeBlock(distribucion=code_block_11) { distribucion[1]; }
code_block_16 = CodeBlock(capa=code_block_11) { capa[5]; }
code_block_17 = CodeBlock(t3=code_block_15, t4=code_block_16)
# ---------- code_block_17.designscript (8 lines) ----------
t2 = t3;
t1 = t2;
vector1 = Autodesk.Surface.NormalAtParameter(t1, 0.5, 0.5);
vector2 = Autodesk.Vector.Reverse(vector1);
surface = Autodesk.Geometry.Translate(t3, vector2, t4)[0];
point = Autodesk.Surface.PointAtParameter(surface, 0.5, 0.5);
surface_normal = Autodesk.Surface.NormalAtParameter(surface, 0.5, 0.5);
plane = Autodesk.Plane.ByOriginNormal(point, surface_normal);
# ----------------------------------------
code_block_18 = CodeBlock(solid=to_empty_list, plane_cut=code_block_17.plane)
# ---------- code_block_18.designscript (13 lines) ----------
solid;
plane_cut;

geometry1 = Autodesk.Geometry.Intersect(solid, plane_cut);
point1 = Autodesk.Surface.PointAtParameter(geometry1, 0.5, 0.5);
vector1 = Autodesk.Vector.ZAxis();
geometry2 = Autodesk.Geometry.Rotate(geometry1, point1, vector1, 90);
geometry11 = geometry2;
point11 = Autodesk.Surface.PointAtParameter(geometry11, 0.5, 0.5);
vector11 = Autodesk.Surface.NormalAtPoint(geometry11, point11);
plane1 = Autodesk.Plane.ByOriginNormal(point11, vector11);
geometry3 = Autodesk.Geometry.Scale(geometry2, plane1, 1, 15, 1);
geometry4 = Autodesk.Geometry.Intersect(geometry1, plane1);
# ----------------------------------------
to_empty_list_2 = Python(IN[0]=code_block_18.geometry4)
# ---------- to_empty_list_2.python (9 lines) ----------
var = IN[0]
lst = []

if var == lst:
	x = [] 
else:
	x = var[0][0]

OUT = x
# ----------------------------------------
code_block_19 = CodeBlock(t1=to_empty_list_2)
# ---------- code_block_19.designscript (4 lines) ----------
vector1 = Autodesk.Vector.ZAxis();
vector2 = StructuralDesign.Vector.ByLine(t1);
bool1 = Autodesk.Vector.IsAlmostEqualTo(vector1, vector2);
curve1 = Autodesk.Curve.Reverse(t1);
# ----------------------------------------
if_ = If(test=code_block_19.bool1, true=code_block_19.curve1, false=to_empty_list_2)
code_block_20 = CodeBlock(t1=if_) { curve1 = Autodesk.Curve.ExtendEnd(t1, -50); curve2 = Autodesk.Curve.ExtendStart(curve1, -20); }
normal_para_posicionamiento_de = Python(IN[0]=code_block_18.vector11)  # "Normal para Posicionamiento de Barra"
# ---------- normal_para_posicionamiento_de.python (9 lines) ----------
var = IN[0]
lst = []

if var == lst:
	x = [] 
else:
	x = var[0]

OUT = x
# ----------------------------------------
code_block_21 = CodeBlock(muros=code_block_11) { muros[0]; }
python_script = Python(IN[0]=code_block_21)  # same code as normal_para_posicionamiento_de
code_block_22 = CodeBlock(t6=python_script)
# ---------- code_block_22.designscript (6 lines) ----------
t4 = t6;
t2 = t4;
t1 = Revit.Elements.Element.GetParameterValueByName(t2, "Type");
t3 = Revit.Elements.Element.GetParameterValueByName(t1, "Width");
t5 = t3 / 2;
t7 = t5 - 40;
# ----------------------------------------
translate = Geometry.Translate(geometry=code_block_20.curve2, direction=normal_para_posicionamiento_de, distance=code_block_22.t7, lacing=Longest)
reverse = Curve.Reverse(curve=translate)
code_block_23 = CodeBlock(empalmes=code_block_11) { empalmes[2]; }
planos_para_generar_empalmes = CodeBlock(t1=code_block_23)
# ---------- planos_para_generar_empalmes.designscript (3 lines) ----------
point1 = Autodesk.Surface.PointAtParameter(t1, 0.5, 0.5);
vector1 = Autodesk.Surface.NormalAtPoint(t1, point1);
plane1 = Autodesk.Plane.ByOriginNormal(point1, vector1);
# ----------------------------------------
intersect = Geometry.Intersect(geometry=reverse, other=planos_para_generar_empalmes.plane1)
flatten = List.Flatten(list=intersect)
solidos_de_muros_seleccionados_2 = CodeBlock(curve=reverse, points=flatten, muros=code_block_21)
# ---------- solidos_de_muros_seleccionados_2.designscript (14 lines) ----------
curve;
points;

elem_geom = Revit.Elements.Element.Geometry(muros);
elem_geom_flat = DSCore.List.Flatten(elem_geom, -1);
centroid_geom = Autodesk.Solid.Centroid(elem_geom_flat);
plane = Autodesk.Plane.ByOriginNormal(centroid_geom, Autodesk.Vector.ZAxis());
elem_geom_scaled = Autodesk.Geometry.Scale(elem_geom_flat, plane, 1, 5, 1);

curve_splited = Autodesk.Curve.SplitByPoints(curve, points);
point_at_param = Autodesk.Curve.PointAtParameter(curve_splited, 0.1);
bool_intersect =Autodesk.Geometry.DoesIntersect(elem_geom_scaled@L1<1L>, point_at_param@L2<1L>);
mask = Orchid.List.AnyTrue(bool_intersect);
host_elem = DSCore.List.FilterByBoolMask(muros, mask)["in"];
# ----------------------------------------
intersect_2 = Geometry.Intersect(geometry=reverse, other=planos_para_generar_empalmes.plane1)
flatten_2 = List.Flatten(list=intersect_2)
splitByPoints = Curve.SplitByPoints(curve=reverse, points=flatten_2)
list_create_3 = List.Create(item0=solidos_de_muros_seleccionados_2.host_elem, item1=splitByPoints)
transpose = List.Transpose(lists=list_create_3)
python_script_2 = Python(IN[0]=transpose)
# ---------- python_script_2.python (9 lines) ----------
var = IN[0]
lst = []

if var == lst:
	x = [] 
else:
	x = var[-1]

OUT = x
# ----------------------------------------
lineas = Python(IN[0]=python_script_2)
# ---------- lineas.python (9 lines) ----------
var = IN[0]
lst = []

if var == lst:
	x = [] 
else:
	x = var[1]

OUT = x
# ----------------------------------------
code_block_24 = CodeBlock(tip_barra=code_block_11) { tip_barra[3]; }
element_types_ᶜᵒⁿᵛᵉʳᵗᵉᵈ_ᵈʳᵒᵖᵈᵒʷⁿ_2 = CodeBlock { DSCore.Types.FindTypeByNameInAssembly("RebarHookType", "RevitAPI"); }
all_elements_of_type_2 = ElementsOfType(element_type=element_types_ᶜᵒⁿᵛᵉʳᵗᵉᵈ_ᵈʳᵒᵖᵈᵒʷⁿ_2)
rebar_hook_type_at_start = CodeBlock(t3=all_elements_of_type_2)
# ---------- rebar_hook_type_at_start.designscript (5 lines) ----------
t1 = t3;
str2 = Revit.Elements.Element.Name(t1);
t2 = str2 == "Standard - 90 deg.";
t4 = DSCore.List.FilterByBoolMask(t3, t2);
t5 = Dictionary.ValueAtKey(t4, "in");
# ----------------------------------------
anfitriones = Python(IN[0]=python_script_2)  # same code as normal_para_posicionamiento_de
reverse_2 = Vector.Reverse(vector=normal_para_posicionamiento_de)
code_block_25 = CodeBlock(curves=lineas, rebarBarType=code_block_24, endHookType=rebar_hook_type_at_start.t5, hostElement=anfitriones, vector=reverse_2)
# ---------- code_block_25.designscript (18 lines) ----------
//curves
curves;
//rebarStyle
"Standard";
//rebarBarType
rebarBarType;
//startHookType
null;
//endHookType
endHookType;
//startHookOrientation
"Left";
//endtHookOrientation
"Left";
//hostElement
hostElement;
//vector
vector;
# ----------------------------------------
fromCurves = StructuralDesign.Rebar.Create.FromCurves(curves=code_block_25.curves@L1, rebarStyle=code_block_25.out1@L1, rebarBarType=code_block_25.rebarBarType@L1, startHookType=code_block_25.out3@L1, endHookType=code_block_25.endHookType@L1, startHookOrientation=code_block_25.out5@L1, endHookOrientation=code_block_25.out6@L1, hostElement=code_block_25.hostElement@L1, vector=code_block_25.vector@L1, lacing=Longest)
element_types_ᶜᵒⁿᵛᵉʳᵗᵉᵈ_ᵈʳᵒᵖᵈᵒʷⁿ_3 = CodeBlock { DSCore.Types.FindTypeByNameInAssembly("RebarShape", "RevitAPI"); }
all_elements_of_type_3 = ElementsOfType(element_type=element_types_ᶜᵒⁿᵛᵉʳᵗᵉᵈ_ᵈʳᵒᵖᵈᵒʷⁿ_3)
code_block_26 = CodeBlock(t1=all_elements_of_type_3)
# ---------- code_block_26.designscript (5 lines) ----------
"Shape";
str2 = Revit.Elements.Element.Name(t1);
t2 = str2 == "R_S_01";
t3 = DSCore.List.FilterByBoolMask(t1, t2);
t4 = Dictionary.ValueAtKey(t3, "in");
# ----------------------------------------
setParameterByName = Element.SetParameterByName(element=fromCurves, parameterName=code_block_26.out0, value=code_block_26.t4, lacing=Longest)
code_block_27 = CodeBlock { "Capa"; }
code_block_28 = CodeBlock(capa=code_block_11) { capa[5]; }
string_from_object = FromObject(obj=code_block_28)
numero_de_capa = CodeBlock(capa=string_from_object)
# ---------- numero_de_capa.designscript (4 lines) ----------
key = ["40", "140", "240", "340", "440"];
val = ["1", "2", "3", "4", "5"];
dict_capa = Dictionary.ByKeysValues(key, val);
t3 = Dictionary.ValueAtKey(dict_capa, capa);
# ----------------------------------------
setParameterByName_2 = Element.SetParameterByName(element=setParameterByName, parameterName=code_block_27, value=numero_de_capa.t3)
code_block_29 = CodeBlock { "Override Hook Lengths"; 1; }
setParameterByName_3 = Element.SetParameterByName(element=setParameterByName_2, parameterName=code_block_29.out0, value=code_block_29.out1)
ꟿ_list_dropfirstlast = Custom[ꟿ List.DropFirstLast](list=transpose)  # package spring nodes; Removes the first and last items from the list
transpose_2 = List.Transpose(lists=ꟿ_list_dropfirstlast.rest)
lineas_2 = Python(IN[0]=transpose_2)  # same code as lineas
code_block_30 = CodeBlock(tip_barra=code_block_11) { tip_barra[3]; }
traslapo_armadura = CodeBlock(rebar=code_block_30)
# ---------- traslapo_armadura.designscript (5 lines) ----------
diametro_barra = Strings.ToString(Properties.RebarDiameter(rebar),"");
key = ["8","10","12","16","18","22","25","28","32","36"];
val = [570, 710, 860, 1140, 1290, 1960, 2230, 2500, 2850, 3210];
dict_traslapo = Dictionary.ByKeysValues(key, val);
t3 = Dictionary.ValueAtKey(dict_traslapo, diametro_barra);
# ----------------------------------------
extendEnd = Curve.ExtendEnd(curve=lineas_2, distance=traslapo_armadura.t3)
anfitriones_2 = Python(IN[0]=transpose_2)  # same code as normal_para_posicionamiento_de
reverse_3 = Vector.Reverse(vector=normal_para_posicionamiento_de)
code_block_31 = CodeBlock(curves=extendEnd, rebarBarType=code_block_30, hostElement=anfitriones_2, vector=reverse_3)
# ---------- code_block_31.designscript (18 lines) ----------
//curves
curves;
//rebarStyle
"Standard";
//rebarBarType
rebarBarType;
//startHookType
null;
//endHookType
null;
//startHookOrientation
"Left";
//endtHookOrientation
"Left";
//hostElement
hostElement;
//vector
vector;
# ----------------------------------------
fromCurves_2 = StructuralDesign.Rebar.Create.FromCurves(curves=code_block_31.curves@L1, rebarStyle=code_block_31.out1@L1, rebarBarType=code_block_31.rebarBarType@L1, startHookType=code_block_31.out3@L1, endHookType=code_block_31.out4@L1, startHookOrientation=code_block_31.out5@L1, endHookOrientation=code_block_31.out6@L1, hostElement=code_block_31.hostElement@L1, vector=code_block_31.vector@L1, lacing=Longest)
element_types_ᶜᵒⁿᵛᵉʳᵗᵉᵈ_ᵈʳᵒᵖᵈᵒʷⁿ_4 = CodeBlock { DSCore.Types.FindTypeByNameInAssembly("RebarShape", "RevitAPI"); }
all_elements_of_type_4 = ElementsOfType(element_type=element_types_ᶜᵒⁿᵛᵉʳᵗᵉᵈ_ᵈʳᵒᵖᵈᵒʷⁿ_4)
code_block_32 = CodeBlock(t1=all_elements_of_type_4)
# ---------- code_block_32.designscript (5 lines) ----------
"Shape";
str2 = Revit.Elements.Element.Name(t1);
t2 = str2 == "R_S_00";
t3 = DSCore.List.FilterByBoolMask(t1, t2);
t4 = Dictionary.ValueAtKey(t3, "in");
# ----------------------------------------
setParameterByName_4 = Element.SetParameterByName(element=fromCurves_2, parameterName=code_block_32.out0, value=code_block_32.t4, lacing=Longest)
code_block_33 = CodeBlock { "Capa"; }
setParameterByName_5 = Element.SetParameterByName(element=setParameterByName_4, parameterName=code_block_33, value=numero_de_capa.t3)
code_block_34 = CodeBlock { "Override Hook Lengths"; 1; }
setParameterByName_6 = Element.SetParameterByName(element=setParameterByName_5, parameterName=code_block_34.out0, value=code_block_34.out1)
python_script_3 = Python(IN[0]=transpose)  # same code as normal_para_posicionamiento_de
lineas_3 = Python(IN[0]=python_script_3)  # same code as lineas
code_block_35 = CodeBlock(tip_barra=code_block_11) { tip_barra[3]; }
traslapo_armadura_2 = CodeBlock(rebar=code_block_35)  # same code as traslapo_armadura
extendEnd_2 = Curve.ExtendEnd(curve=lineas_3, distance=traslapo_armadura_2.t3)
element_types_ᶜᵒⁿᵛᵉʳᵗᵉᵈ_ᵈʳᵒᵖᵈᵒʷⁿ_5 = CodeBlock { DSCore.Types.FindTypeByNameInAssembly("RebarHookType", "RevitAPI"); }
all_elements_of_type_5 = ElementsOfType(element_type=element_types_ᶜᵒⁿᵛᵉʳᵗᵉᵈ_ᵈʳᵒᵖᵈᵒʷⁿ_5)
rebar_hook_type_at_start_2 = CodeBlock(t3=all_elements_of_type_5)  # same code as rebar_hook_type_at_start
anfitriones_3 = Python(IN[0]=python_script_3)  # same code as normal_para_posicionamiento_de
reverse_4 = Vector.Reverse(vector=normal_para_posicionamiento_de)
code_block_36 = CodeBlock(curves=extendEnd_2, rebarBarType=code_block_24, startHookType=rebar_hook_type_at_start_2.t5, hostElement=anfitriones_3, vector=reverse_4)
# ---------- code_block_36.designscript (18 lines) ----------
//curves
curves;
//rebarStyle
"Standard";
//rebarBarType
rebarBarType;
//startHookType
startHookType;
//endHookType
null;
//startHookOrientation
"Left";
//endtHookOrientation
"Left";
//hostElement
hostElement;
//vector
vector;
# ----------------------------------------
fromCurves_3 = StructuralDesign.Rebar.Create.FromCurves(curves=code_block_36.curves@L1, rebarStyle=code_block_36.out1@L1, rebarBarType=code_block_36.rebarBarType@L1, startHookType=code_block_36.startHookType@L1, endHookType=code_block_36.out4@L1, startHookOrientation=code_block_36.out5@L1, endHookOrientation=code_block_36.out6@L1, hostElement=code_block_36.hostElement@L1, vector=code_block_36.vector@L1, lacing=Longest)
element_types_ᶜᵒⁿᵛᵉʳᵗᵉᵈ_ᵈʳᵒᵖᵈᵒʷⁿ_6 = CodeBlock { DSCore.Types.FindTypeByNameInAssembly("RebarShape", "RevitAPI"); }
all_elements_of_type_6 = ElementsOfType(element_type=element_types_ᶜᵒⁿᵛᵉʳᵗᵉᵈ_ᵈʳᵒᵖᵈᵒʷⁿ_6)
code_block_37 = CodeBlock(t1=all_elements_of_type_6)  # same code as code_block_26
setParameterByName_7 = Element.SetParameterByName(element=fromCurves_3, parameterName=code_block_37.out0, value=code_block_37.t4, lacing=Longest)
code_block_38 = CodeBlock { "Capa"; }
setParameterByName_8 = Element.SetParameterByName(element=setParameterByName_7, parameterName=code_block_38, value=numero_de_capa.t3)
code_block_39 = CodeBlock { "Override Hook Lengths"; 1; }
setParameterByName_9 = Element.SetParameterByName(element=setParameterByName_8, parameterName=code_block_39.out0, value=code_block_39.out1)
list_create_4 = List.Create(item0=setParameterByName_3, item1=setParameterByName_6, item2=setParameterByName_9)
flatten_3 = List.Flatten(list=list_create_4)
desplazamiento_barra = CodeBlock(t2=python_script)
# ---------- desplazamiento_barra.designscript (3 lines) ----------
t1 = Revit.Elements.Element.GetParameterValueByName(t2, "Type");
t3 = Revit.Elements.Element.GetParameterValueByName(t1, "Width");
t4 = t3 - 80;
# ----------------------------------------
code_block_40 = CodeBlock(cant_barra=code_block_11) { cant_barra[4]; }
setLayoutAsFixedNumber = StructuralDesign.Rebar.Layout.SetLayoutAsFixedNumber(rebar=flatten_3, arrayLength=desplazamiento_barra.t4, numberOfBarPositions=code_block_40)
encuentra_curvas_para_defginir = CodeBlock(element1=setLayoutAsFixedNumber)  # "Encuentra Curvas para defginir Traslapos"
# ---------- encuentra_curvas_para_defginir.designscript (12 lines) ----------
curve1 = Properties.RebarCenterlineCurves(element1, false, true, true, true, 0);
t2 = DSCore.List.Flatten(curve1, -1);
geometry1 = Autodesk.Geometry.Intersect(t2@L1<1L>, t2@L2<1L>);
t3 = DSCore.List.Flatten(geometry1, -1);
num1 = Autodesk.Curve.Length(t3);
t1 = [570, 710, 860, 1140, 1290, 1960, 2230, 2500, 2850, 3210];
t4 = num1@L1<1L> == t1@L2<1L>;
bool1 = Orchid.List.AnyTrue(t4@L2<1>);
t5 = DSCore.List.FilterByBoolMask(t3, bool1);
t6 = Dictionary.ValueAtKey(t5, "in");
t7 = Dictionary.ValueAtKey(t5, "out");
element2 = RevitProject.Document.ActiveView(null);
# ----------------------------------------
pruneDuplicates = Custom[Geometry.PruneDuplicates](GeometryList=encuentra_curvas_para_defginir.t6)  # package Data-Shapes; Removes all duplicate geometries from list.
plane = Custom[View.Plane](view=encuentra_curvas_para_defginir.element2)  # package Clockwork for Dynamo 2.x; Retrieves the plane of a given view
code_block_41 = CodeBlock(t1=pruneDuplicates, t2=plane) { curve1 = Autodesk.Curve.PullOntoPlane(t1, t2); }
family_types_ᶜᵒⁿᵛᵉʳᵗᵉᵈ_ᵈʳᵒᵖᵈᵒʷⁿ = CodeBlock { Revit.Elements.FamilyType.ByName("EST_D_DEATIL ITEM_EMPALME"); }
o_document_activeview_2 = Orchid.RevitProject.Common.Document.ActiveView()
byCurve = Custom[DetailComponent.ByCurve](curve=code_block_41, familyType=family_types_ᶜᵒⁿᵛᵉʳᵗᵉᵈ_ᵈʳᵒᵖᵈᵒʷⁿ, view=o_document_activeview_2)  # package Clockwork for Dynamo 2.x; Places a line-based detail component in a given view
end = Revit.Transaction.Transaction.End(input=byCurve)
familyinstance_2d_geometry = Custom[FamilyInstance 2D Geometry](element=end)  # package Genius Loci; Gets the curves of the family instance. Works only with the family categories : Generic Annotation and Detail Item.
control_de_flujo = Python(IN[0]=familyinstance_2d_geometry)
# ---------- control_de_flujo.python (9 lines) ----------
var = IN[0]
lst = []

if var == lst:
	x = [] 
else:
	x = 0.001

OUT = x
# ----------------------------------------
byJoinedCurves = PolyCurve.ByJoinedCurves(curves=familyinstance_2d_geometry, joinTolerance=control_de_flujo)
byPatch = Surface.ByPatch(closedCurve=byJoinedCurves)
control_de_flujo_2 = Python(IN[0]=byPatch)
# ---------- control_de_flujo_2.python (9 lines) ----------
var = IN[0]
lst = []

if var == lst:
	x = [] 
else:
	x = [1, 0]

OUT = x
# ----------------------------------------
code_block_42 = CodeBlock { [0.5, 0.5]; }
pointAtParameter = Surface.PointAtParameter(surface=byPatch@L2, u=control_de_flujo_2, v=code_block_42, lacing=Longest)
transpose_3 = List.Transpose(lists=pointAtParameter)
function_apply = ApplyFunction(func=byBestFitThroughPoints, arg1=transpose_3)
code_block_43 = CodeBlock(distribucion=code_block_11) { distribucion[1]; }
plano_para_ajustar_tag = CodeBlock(t2=code_block_43)
# ---------- plano_para_ajustar_tag.designscript (6 lines) ----------
t1 = t2;
vector1 = Autodesk.Surface.NormalAtParameter(t1, 0.5, 0.5);
geometry1 = Autodesk.Geometry.Translate(t1, vector1, 200);
point1 = Autodesk.Surface.PointAtParameter(geometry1, 0.5, 0.5);
vector2 = Autodesk.Surface.NormalAtPoint(geometry1, point1);
plane1 = Autodesk.Plane.ByOriginNormal(point1, vector2);
# ----------------------------------------
pullOntoPlane = Curve.PullOntoPlane(curve=function_apply, plane=plano_para_ajustar_tag.plane1)
code_block_44 = CodeBlock { ["Right", "Left"]; }
familyinstance_reference_byname = Custom[FamilyInstance Reference ByName](familyInstance=end@L1, name=code_block_44@L2, lacing=Longest)  # package Genius Loci; Works only in Revit 2018.1 and later. Gets the reference corresponding to the named reference plane in the instance's family.
transpose_4 = List.Transpose(lists=familyinstance_reference_byname.Reference@L2)
element_types_ᶜᵒⁿᵛᵉʳᵗᵉᵈ_ᵈʳᵒᵖᵈᵒʷⁿ_7 = CodeBlock { DSCore.Types.FindTypeByNameInAssembly("DimensionType", "RevitAPI"); }
all_elements_of_type_7 = ElementsOfType(element_type=element_types_ᶜᵒⁿᵛᵉʳᵗᵉᵈ_ᵈʳᵒᵖᵈᵒʷⁿ_7)
name = Element.Name(element=all_elements_of_type_7)
code_block_45 = CodeBlock { "Linear - 2.5mm Arial"; }
eq = name == code_block_45
filterByBoolMask = List.FilterByBoolMask(list=all_elements_of_type_7, mask=eq)
dimension_byreferences = Custom[Dimension ByReferences](view=o_document_activeview@L1, line=pullOntoPlane@L1, references=transpose_4@L2, dimensionType=filterByBoolMask.in@L1, lacing=Longest)  # package Genius Loci; Creates a new linear dimension from at least two geometric references of an object.
o_document_activeview_3 = Orchid.RevitProject.Common.Document.ActiveView()
code_block_46 = CodeBlock(capa=code_block_11) { capa[5]; }
string_from_object_2 = FromObject(obj=code_block_46)
desplazamiento_etiquetas_por = CodeBlock(t3=string_from_object_2)  # "Desplazamiento Etiquetas por capa"
# ---------- desplazamiento_etiquetas_por.designscript (4 lines) ----------
t1 = ["40", "140", "240", "340", "440"];
t2 = [0.15, 0.30, 0.45, 0.60, 0.75];
dictionary1 = Dictionary.ByKeysValues(t1, t2);
t4 = Dictionary.ValueAtKey(dictionary1, t3);
# ----------------------------------------
plano_para_ajustar_tag_2 = CodeBlock(t2=code_block_43)
# ---------- plano_para_ajustar_tag_2.designscript (6 lines) ----------
t1 = t2;
vector1 = Autodesk.Surface.NormalAtParameter(t1, 0.5, 0.5);
geometry1 = Autodesk.Geometry.Translate(t1, vector1, 900);
point1 = Autodesk.Surface.PointAtParameter(geometry1, 0.5, 0.5);
vector2 = Autodesk.Surface.NormalAtPoint(geometry1, point1);
plane1 = Autodesk.Plane.ByOriginNormal(point1, vector2);
# ----------------------------------------
code_block_47 = CodeBlock(element2=setParameterByName_3, des_etiqueta=desplazamiento_etiquetas_por.t4, plane1=plano_para_ajustar_tag_2.plane1)
# ---------- code_block_47.designscript (6 lines) ----------
element1 = element2;
curve1 = Properties.RebarCenterlineCurves(element1, false, true, true, true, 0);
t1 = DSCore.List.Flatten(curve1, -1);
point1 = Autodesk.Curve.PointAtParameter(t1, des_etiqueta);
t2 = DSCore.List.Flatten(point1, -1);
point2 = Points.PullOntoPlane(t2, plane1);
# ----------------------------------------
code_block_48 = CodeBlock()
# ---------- code_block_48.designscript (4 lines) ----------
family1 = Revit.Family.ByName("EST_A_STRUCTURAL REBAR TAG_STANDAR");
familytype1 = Revit.Elements.FamilyType.ByFamilyAndName(family1, "R_S_01");
true;
true;
# ----------------------------------------
create_tag = Custom[Create Tag](view=o_document_activeview_3@L1, element=setParameterByName_3@L1, TagLocation=code_block_47.point2@L1, TagType=code_block_48.familytype1@L1, addLeader=code_block_48.out2@L1, RunIt=code_block_48.out3@L1, lacing=Longest)  # package Genius Loci; Works only in Revit 2018 and later. Creates a tag at a given location, of given type and in a supplied view. The node also works with Linked Elements (except space and area), Multi Category tag and Material Tag. Based on an archilab node
flatten_4 = List.Flatten(list=create_tag)
tag_setlocation = Custom[Tag SetLocation](tag=flatten_4, location=code_block_47.point2)  # package Genius Loci; Moves the head of the tag to the given location point.
o_document_activeview_4 = Orchid.RevitProject.Common.Document.ActiveView()
code_block_49 = CodeBlock(capa=code_block_11) { capa[5]; }
string_from_object_3 = FromObject(obj=code_block_49)
desplazamiento_etiquetas_por_2 = CodeBlock(t3=string_from_object_3)  # "Desplazamiento Etiquetas por capa"
# ---------- desplazamiento_etiquetas_por_2.designscript (4 lines) ----------
t1 = ["40", "140", "240", "340", "440"];
t2 = [0.3, 0.35, 0.4, 0.45, 0.5];
dictionary1 = Dictionary.ByKeysValues(t1, t2);
t4 = Dictionary.ValueAtKey(dictionary1, t3);
# ----------------------------------------
code_block_50 = CodeBlock(element1=setParameterByName_6, des_etiqueta=desplazamiento_etiquetas_por_2.t4, plane1=plano_para_ajustar_tag_2.plane1)
# ---------- code_block_50.designscript (4 lines) ----------
curve1 = Properties.RebarCenterlineCurves(element1, false, true, true, true, 0);
t1 = DSCore.List.Flatten(curve1, -1);
point1 = Autodesk.Curve.PointAtParameter(t1, des_etiqueta);
point2 = Points.PullOntoPlane(point1<1L>, plane1<1L>);
# ----------------------------------------
code_block_51 = CodeBlock()
# ---------- code_block_51.designscript (4 lines) ----------
family1 = Revit.Family.ByName("EST_A_STRUCTURAL REBAR TAG_STANDAR");
familytype1 = Revit.Elements.FamilyType.ByFamilyAndName(family1, "R_S_00");
true;
true;
# ----------------------------------------
create_tag_2 = Custom[Create Tag](view=o_document_activeview_4@L1, element=setParameterByName_6@L1, TagLocation=code_block_50.point2@L1, TagType=code_block_51.familytype1@L1, addLeader=code_block_51.out2@L1, RunIt=code_block_51.out3@L1, lacing=Longest)
flatten_5 = List.Flatten(list=create_tag_2)
tag_setlocation_2 = Custom[Tag SetLocation](tag=flatten_5, location=code_block_50.point2)
o_document_activeview_5 = Orchid.RevitProject.Common.Document.ActiveView()
desplazamiento_etiquetas_por_3 = CodeBlock(t3=string_from_object_2)  # "Desplazamiento Etiquetas por capa"; same code as desplazamiento_etiquetas_por
code_block_52 = CodeBlock(element2=setParameterByName_9, des_etiqueta=desplazamiento_etiquetas_por_3.t4, plane1=plano_para_ajustar_tag_2.plane1)  # same code as code_block_47
code_block_53 = CodeBlock()  # same code as code_block_48
create_tag_3 = Custom[Create Tag](view=o_document_activeview_5@L1, element=setParameterByName_9@L1, TagLocation=code_block_52.point2@L1, TagType=code_block_53.familytype1@L1, addLeader=code_block_53.out2@L1, RunIt=code_block_53.out3@L1, lacing=Longest)
flatten_6 = List.Flatten(list=create_tag_3)
tag_setlocation_3 = Custom[Tag SetLocation](tag=flatten_6, location=code_block_52.point2)
code_block_54 = CodeBlock(x=code_block_17.plane) { x; }
